% Simulink data dictionary PIDControl.sldd

Kp = Simulink.Parameter([])
Ki = Simulink.Parameter([])
Kd = Simulink.Parameter([])
Ts_PID = Simulink.Parameter(0.001, DataType="double", Unit="s")
w_max = Simulink.Parameter(534.0708, DataType="double", Unit="rad/s")  % Máxima velocidade do motor em regime permanente