% Simulink data dictionary PwmGenerator.sldd

pwm_freq = Simulink.Parameter(1000, DataType="double", Unit="Hz")  % Frequencia do PWM do controlador.
TTL_amplitude = Simulink.Parameter(5, DataType="double", Min=0, Max=5, Unit="V")  % Amplitude do sinal lógico PWM, relacionada ao sistema embarcado na fase de deploy.