test file "DcMotorTests"

suite "MOT_CTRL-MOT-FUN"

  case "MOT_CTRL-MOT-FUN-001" [baseline]
    description: Esse modelo implementa o teste de relação entre tensão de alimentação da armadura do motor e velocidade angular no eixo.
    model DcMotorSimulink, harness MOT_CTRL_MOT_FUN_001
    assessment "VoltageSpeedRelationship": At any point of time, whenever t > 1.0001 is true then, with no delay, result_sim == true must be true
      result_sim: signal MOT_CTRL_MOT_FUN_001/Test Assessment, port 1

  case "MOT_CTRL-MOT-FUN-002" [baseline]
    model DcMotorSimulink, harness MOT_CTRL_MOT_FUN_002

  case "MOT_CTRL-MOT-FUN-003" [baseline]
    model DcMotorSimulink, harness MOT_CTRL_MOT_FUN_003